% Simulink data dictionary ControlParameters.sldd

ControlInverter_DCVoltage = Simulink.Parameter(380, Min=0, Max=500, Unit="V")
ControlPWM_ModulationPeriod = Simulink.Parameter(2.5e-5)
ControlPWM_PercentAtZeroVolt = Simulink.Parameter(50, Unit="V")
ControlPWM_PercentPerVolt = Simulink.Parameter(Simulink.data.Expression(ExpressionString="50/ControlInverter_DCVoltage"), Unit="%/V")
ControlCurrentPID_I = Simulink.Parameter(1)
ControlCurrentPID_P = Simulink.Parameter(0.00025, Unit="1")
SpeedControl_P = Simulink.Parameter(10, Unit="1")
SpeedControl_I = Simulink.Parameter(1, Unit="1")
CurrentControl_P = Simulink.Parameter(100, Unit="1")
CurrentControl_I = Simulink.Parameter(1, Unit="1")