% Simulink data dictionary ControllerData.sldd
% references SensorData.sldd
% references ControlParameters.sldd
% references UnitsData.sldd

MCBPlant = Simulink.VariantExpression(Condition="pmsmPlantVariant == 1")
PTBSPlant = Simulink.VariantExpression(Condition="pmsmPlantVariant == 2")
SimscapePlant = Simulink.VariantExpression(Condition="pmsmPlantVariant == 3")
adcBits = Simulink.Parameter(16, Unit="1")
adcConversionTime = Simulink.Parameter(1.0e-6, Unit="s")
adcCountAtZeroTransducerVolt = Simulink.Parameter(0, Unit="1")
adcCountMax = Simulink.Parameter(32767, Unit="1")
adcCountMin = Simulink.Parameter(0, Unit="1")
adcCountPerTransducerVolt = Simulink.Parameter(1230, Unit="1/V")
adcDelay = Simulink.Parameter(0, Unit="s")
adcIsSequential = Simulink.Parameter(false, DataType="boolean")
adcTransducerVoltAtZeroAmpere = Simulink.Parameter([0 0], Unit="V")
adcTransducerVoltAtZeroVolt = Simulink.Parameter(0, Unit="V")
adcTransducerVoltPerAmpere = Simulink.Parameter(-0.0667, Unit="V/A")
adcTransducerVoltPerVolt = Simulink.Parameter(0.275, Unit="V/V")

controllerFeedback = Simulink.Bus()
  transducerVoltage: single[2], Unit="V"
  encoderIndexFound: uint16, Unit="1"
  encoderCount: uint16, Unit="1"

controllerInputs = Simulink.Bus()
  motorOn: boolean, Unit="1"
  commandType: Enum: commandTypeEnum, Unit="1"
  velocityCommand: single, Unit="rad/sec"

discInertia = Simulink.Parameter(2.6975e-05, Unit="kg*m*m")
encoderALeadsB = Simulink.Parameter(true, DataType="boolean")
encoderCalibrationDuration = Simulink.Parameter(0.2, Unit="s")
encoderCalibrationVoltage = Simulink.Parameter(5, Unit="V")
encoderDebounceCount = Simulink.Parameter(20, DataType="uint16", Unit="1")
encoderName = "MILE Encoder for EC 60 flat"
encoderPositionValidAtStartup = Simulink.Parameter(true, DataType="boolean")
encoderRotorPositionAtIndex = Simulink.Parameter(0.5, Unit="rad")
idxVec = Simulink.Parameter([0 1 2 3], DataType="uint16", Unit="1")
inverterBusVoltage = Simulink.Parameter(24, Unit="V")
inverterCurrentMax = Simulink.Parameter(30, Unit="A")
inverterName = "PWR-TPI6020"

motorCommands = Simulink.Bus()
  inverterEnable: boolean, Unit="1"
  pwmCompare: uint16[3], Unit="1"

motorMeasurements = Simulink.Bus()
  phaseCurrentA: double, Unit="A"
  phaseCurrentB: double, Unit="A"
  phaseCurrentC: double, Unit="A"
  directCurrent: double, Unit="A"
  quadratureCurrent: double, Unit="A"
  electromagneticTorque: double, Unit="N*m"
  rotorPosition: double, Unit="rad"
  electricalPosition: double, Unit="rad"
  rotorVelocity: double, Unit="rad/sec"
  electricalVelocity: double, Unit="rad/sec"

paramCalibrateAtStartup = Simulink.Parameter(true, DataType="boolean")
paramEncoderRotorPositionAtZeroCount = 0.22933
paramOpenLoopVelocityAcceleration = Simulink.Parameter(40, Unit="1")
paramOpenLoopVelocityToVoltsBias = Simulink.Parameter(0.5, Unit="V")
paramOpenLoopVelocityToVoltsScalar = Simulink.Parameter(0.05, Unit="V")
paramOverCurrentEnable = Simulink.Parameter(false, DataType="boolean")
paramOverCurrentLimit = Simulink.Parameter(10, Unit="A")
paramVelocityControlI = Simulink.Parameter(0.06, Unit="1")
paramVelocityControlP = Simulink.Parameter(0.02, Unit="1")

physicalInputs = Simulink.Bus()
  torqueLoad: double, Unit="N*m"
  connectCurrentSensor: boolean, Unit="1"
  motorBrake: boolean, Unit="1"

pmsmBreakawayFrictionTorque = Simulink.Parameter(0.1, Unit="N*m")
pmsmBreakawayFrictionVelocity = Simulink.Parameter(0.060623, Unit="rad/s")
pmsmCoulombFrictionTorque = Simulink.Parameter(0.001, Unit="N*m")
pmsmCurrentMax = Simulink.Parameter(5.4, Unit="A")
pmsmInductanceL0 = Simulink.Parameter(0.000279, Unit="H")
pmsmInductanceLd = Simulink.Parameter(0.000279, Unit="H")
pmsmInductanceLq = Simulink.Parameter(0.000279, Unit="H")
pmsmInertia = Simulink.Parameter(8.35e-5, Unit="kg*m*m")
pmsmName = "Maxon EC 60 flat"
pmsmNoLoadCurrent = Simulink.Parameter(0.493, Unit="A")
pmsmNoLoadSpeed = Simulink.Parameter(4300, Unit="rpm")
pmsmPlantVariant = 3
pmsmPolePairs = Simulink.Parameter(7, Unit="1")
pmsmRatedCurrent = Simulink.Parameter(5.14, Unit="A")
pmsmRatedSpeed = Simulink.Parameter(3730, Unit="rpm")
pmsmRatedVoltage = Simulink.Parameter(24, Unit="V")
pmsmRotorPositionInit = Simulink.Parameter(0, Unit="rad")
pmsmRotorVelocityInit = Simulink.Parameter(0, Unit="rad/s")
pmsmStatorPhaseResistance = Simulink.Parameter(0.293, Unit="Ω")
pmsmTorqueConstant = Simulink.Parameter(0.0525, Unit="N*m/A")
pmsmVariant = 2
pmsmViscousFrictionCoefficient = Simulink.Parameter(9.0e-5, Unit="N*m*s")
pmsmVoltageMax = Simulink.Parameter(24, Unit="V")
pwmAdcTriggerOnCount = Simulink.Parameter(38, Unit="1")
pwmAdcTriggerOnTime = Simulink.Parameter(5.066667e-07, Unit="s")
pwmComparePerVolt = Simulink.Parameter(62.5, Unit="V")
pwmCountPerPeriod = Simulink.Parameter(3000, DataType="uint16", Unit="1")
pwmCounterMax = Simulink.Parameter(1500, Unit="1")
pwmPeriod = 4.0e-5
pwmTimePerCount = Simulink.Parameter(1.333333e-08, Unit="s")
sampleTimeCurrentControl = Simulink.Parameter(0.00025, Unit="s")
velCmdVec = Simulink.Parameter([-52.3599 0 52.359 104.719], Unit="rad/s")
Param = Simulink.Parameter([])
Param1 = Simulink.Parameter([])
Param2 = Simulink.Parameter([])
Param3 = Simulink.Parameter([])
Var = 0
Var1 = 0
CurrentSensor_Gain = 0.01
CurrentSensor_Bias = 0
CurrentSensor_VMax = 3.3
CurrentSensor_VMin = 0
TI_ADCMax = 3.3
TI_ADCMin = 0
TI_ADCResolution = 2000000000000
Omega2RPM = 9.549297
p = 3
PMSM_PolesPairs = Simulink.Parameter(7, Unit="1")
InverterDCLink_Voltage = Simulink.Parameter(24)
PWMPercentPerVolt = Simulink.Parameter(Simulink.data.Expression(ExpressionString="InverterDCLink_Voltage/100"))
Sig = Simulink.Signal()
PWMPercentAtZeroVolt = Simulink.Parameter(50)
Sig1 = Simulink.Signal()
PWMMod_Period = Simulink.Parameter(2.5e-5, Unit="s")
EncoderCountPerRevolution = Simulink.Parameter(4096, Unit="1")
EncoderNumberOfSlits = Simulink.Parameter(1024, Unit="1")
CountPerVolt = Simulink.Parameter(1236.36, Unit="1/V")
TransduceVoltPerAmpere = Simulink.Parameter(0.1)
InverterCurrent_Max = Simulink.Parameter(1, Unit="A")
FastSim_ElecTs = Simulink.Parameter(0.0005)
FastSim_MecTs = Simulink.Parameter(0.001)
Sig2 = Simulink.Signal()
CurrentControl_Ts = Simulink.Parameter(0.00025, Unit="s")
TransducerVoltAtZeroAmpere = Simulink.Parameter(1.65)
ZeroVoltCount = Simulink.Parameter(-24, Unit="1")
SpeedControl_P = Simulink.Parameter(10, Unit="1")
SpeedControl_I = Simulink.Parameter(1, Unit="1")
CurrentControl_P = Simulink.Parameter(100, Unit="1")
CurrentControl_I = Simulink.Parameter(1, Unit="1")
ADC_VMax = Simulink.Parameter(3.3, Unit="V")  % TI Controller maximum voltage for ADC aquisition.
ADC_VMin = Simulink.Parameter(0, Unit="V")  % TI Controller maximum voltage for ADC aquisition.
ADC_CountMax = Simulink.Parameter(4095)