# Requirement set mbd_elevator (R2024a)

## 1 [REQ01] Conforto do Usuário Segundo ABNT (Container)
O sistema deve apresentar operação confortável, com aceleração e desaceleração suaves, sem trancos ou solvancos.

### 1.1 [REQ02] Aceleração máxima permitida do sistema
O elevador não deve ultrapassar a aceleração máxima.