% Simulink data dictionary Data_PlantDefinition.sldd

PMSM_RatedPower = Simulink.Parameter(10000)
PMSM_RatedVoltage = Simulink.Parameter(380)
CurrentSensor_Gain = Simulink.Parameter(0.001)
CurrentSensor_Bias = Simulink.Parameter(0)

BuildingTop = struct(
  mass=4396.752,
  CoM=[1917.265 1736.626 4.14893],
  MoI=[4.503794e+09 6.109717e+09 9.419953e+09],
  PoI=[6.496061e+08 -3.981047e+08 5.344603e+08],
  color=[0.5019608 0.5019608 0.5019608],
  opacity=1,
  ID="RoofTop*:*Default")

CabinFrame = struct(
  mass=86.03209,
  CoM=[45 65 1.25],
  MoI=[203142 113832.5 316884.9],
  PoI=[-1.866763e-12 0 -3.783236e-11],
  color=[0.7921569 0.8196078 0.9333333],
  opacity=1,
  ID="CabinFrame1*:*Default")

CabinTopPlate = struct(
  mass=72.135,
  CoM=[0.315 1.145 0.025],
  MoI=[31.53862425 2.400893 33.90946],
  PoI=[0 0 9.470213e-15],
  color=[0.7921569 0.8196078 0.9333333],
  opacity=1,
  ID="CabinTopPlate*:*Default")

CounterWeight = struct(
  mass=2200,
  CoM=[0 -240 0],
  MoI=[4261034 5801128 9687938],
  PoI=[0 7.313713e-10 0],
  color=[0.7921569 0.8196078 0.9333333],
  opacity=1,
  ID="CounterWeight*:*Default")

CounterWeightFrame = struct(
  mass=47.51232,
  CoM=[486.7 84.12 -750],
  MoI=[1.472691e+07 2.19859e+07 7483121],
  PoI=[7.059531e-10 3.979453e-09 0],
  color=[0.7921569 0.8196078 0.9333333],
  opacity=1,
  ID="CouterWeightFrame*:*Default")

CouterWeightRail = struct(
  mass=53.56192,
  CoM=[30.23425 45 -12009.42],
  MoI=[4.018861e+09 4.018887e+09 57473.81],
  PoI=[0.8035023 -1718.549 -0.003993395],
  color=[0.6470588 0.6196078 0.5882353],
  opacity=1,
  ID="LongRail*:*Default")

D = 3000

Door = struct(
  mass=61.82634,
  CoM=[254 1200 25.4],
  MoI=[2.958818e+07 1338798 3.090039e+07],
  PoI=[0 0 7.318365e-10],
  color=[0.7921569 0.8196078 0.9333333],
  opacity=1,
  ID="Door*:*Default")

DoorMechanismPlate = struct(
  mass=94.6525,
  CoM=[1013.268 259.3766 48.25744],
  MoI=[2052594 3.247702e+07 3.437243e+07],
  PoI=[-24225.46 285.6957 14857.87],
  color=[0.7921569 0.8196078 0.9333333],
  opacity=1,
  ID="DoorMechanism*:*Default")

DoorPart = struct(
  mass=3.04635,
  CoM=[125 135.9258 -6.60073],
  MoI=[16668.67 17693.49 29867.05],
  PoI=[-1217.619 0 0],
  color=[0.7921569 0.8196078 0.9333333],
  opacity=1,
  ID="doorpart1*:*Default")

ElevatorCabin = struct(
  mass=659.27,
  CoM=[40 56.02387 24.72411],
  MoI=[2878640 2019783 3676928],
  PoI=[-46316.8 -0.0009787457 -0.05822804],
  color=[0.6470588 0.6196078 0.5882353],
  opacity=1,
  ID="ElevatorCabin*:*Default")

ElevatorRail = struct(
  mass=53.56192,
  CoM=[30.23425 45 -12009.42],
  MoI=[4.018861e+09 4.018887e+09 57473.81],
  PoI=[0.8035023 -1718.549 -0.003993395],
  color=[0.6470588 0.6196078 0.5882353],
  opacity=1,
  ID="Part4*:*Default")

Floor = struct(
  mass=9775.099,
  CoM=[80.26158 65.17197 37.0744],
  MoI=[3.341201e+07 5.021295e+07 5.617507e+07],
  PoI=[3119453 -70388.09 32114.04],
  color=[0.6470588 0.6196078 0.5882353],
  opacity=1,
  ID="Floor*:*Default")

FloorHeight = 3.6
K = 25000

MotorShaft = struct(
  mass=4.633849,
  CoM=[0 0 295],
  MoI=[137316.4 137316.4 5792.311],
  PoI=[0 0 0],
  color=[0 0 0],
  opacity=1,
  ID="ShaftMotor*:*Default")

PlanarJoint = struct(Rz=struct(Pos=90), Px=struct(Pos=0), Py=struct(Pos=0), ID="[Part4-1:-:LongRail-2]")
PrismaticJoint = struct(Pz=struct(Pos=0), ID="[Part4-1:-:LongRail-1]")

Pulley = struct(
  radius=0.38,
  mass=24.8527,
  CoM=[0 0 0],
  MoI=[0.9817122 0.9817122 1.941608],
  PoI=[0 0 0.01057854],
  color=[0.9882353 0.7372549 0.5176471],
  opacity=1,
  ID="Pulley*:*Default")

RevoluteJoint = [struct(Rz=struct(Pos=-108.1685), ID="[RoofTop-1:-:PulleySubAssembly-1]"), struct(Rz=struct(Pos=-94.60787), ID="[RoofTop-1:-:PulleySubAssembly-2]"), struct(Rz=struct(Pos=76.24992), ID="[RoofTop-1:-:ShaftMotor-2]"), struct(Rz=struct(Pos=-97.41821), ID="[RoofTop-1:-:shaft-1]")]

RigidTransform = [struct(
  translation=[84.86904 37.19644 -27010],
  angle=2.094395,
  axis=[0.5773503 0.5773503 0.5773503],
  ID="B[LongRail-1:-:LongRail-2]"), struct(
  translation=[1063.611 52.80356 -27010],
  angle=2.094395,
  axis=[0.5773503 -0.5773503 -0.5773503],
  ID="F[LongRail-1:-:LongRail-2]"), struct(
  translation=[2867.796 -25382.67 2350.108],
  angle=2.094395,
  axis=[0.5773503 0.5773503 0.5773503],
  ID="B[CounterWeigthAssembly-1:-:LongRail-1]"), struct(
  translation=[90.21075 127.8783 -17445.49],
  angle=2.094395,
  axis=[-0.5773503 0.5773503 0.5773503],
  ID="F[CounterWeigthAssembly-1:-:LongRail-1]"), struct(
  translation=[2699.556 -25382.67 1376.708],
  angle=3.141593,
  axis=[1 0 0],
  ID="B[CounterWeigthAssembly-1:-:LongRail-2]"), struct(
  translation=[84.86904 130.3617 -17445.49],
  angle=2.094395,
  axis=[0.5773503 -0.5773503 -0.5773503],
  ID="F[CounterWeigthAssembly-1:-:LongRail-2]"), struct(
  translation=[1910 1563.156 -700],
  angle=2.094395,
  axis=[-0.5773503 -0.5773503 -0.5773503],
  ID="B[RoofTop-1:-:PulleySubAssembly-1]"), struct(
  translation=[-29.12246 23.42003 678.2007],
  angle=3.141593,
  axis=[-1 2.555075e-33 -7.107237e-17],
  ID="F[RoofTop-1:-:PulleySubAssembly-1]"), struct(
  translation=[930 1563.156 -1100],
  angle=2.094395,
  axis=[-0.5773503 -0.5773503 -0.5773503],
  ID="B[RoofTop-1:-:PulleySubAssembly-2]"), struct(
  translation=[-29.12246 23.42003 679.2007],
  angle=3.141593,
  axis=[-1 3.130912e-33 -6.066163e-17],
  ID="F[RoofTop-1:-:PulleySubAssembly-2]"), struct(
  translation=[930 1563.156 -1100],
  angle=2.094395,
  axis=[-0.5773503 -0.5773503 -0.5773503],
  ID="B[RoofTop-1:-:ShaftMotor-2]"), struct(
  translation=[-6.672549e-13 1.099605e-12 848.1304],
  angle=3.141593,
  axis=[1 -2.813465e-33 -6.809156e-17],
  ID="F[RoofTop-1:-:ShaftMotor-2]"), struct(
  translation=[1910 1563.156 -700],
  angle=2.094395,
  axis=[-0.5773503 -0.5773503 -0.5773503],
  ID="B[RoofTop-1:-:shaft-1]"), struct(
  translation=[2.254706e-13 -2.93564e-14 800],
  angle=3.141593,
  axis=[-1 3.066107e-33 -6.311925e-17],
  ID="F[RoofTop-1:-:shaft-1]"), struct(
  translation=[-2.220446e-12 3600 -254],
  angle=2.094395,
  axis=[-0.5773503 -0.5773503 -0.5773503],
  ID="B[Floor-1:-:RoofTop-1]"), struct(
  translation=[4060 3094 300],
  angle=3.141593,
  axis=[-0.7071068 0.7071068 5.551115e-17],
  ID="F[Floor-1:-:RoofTop-1]"), struct(
  translation=[409 -4.440892e-13 3000],
  angle=2.094395,
  axis=[-0.5773503 -0.5773503 0.5773503],
  ID="B[Part4-1:-:LongRail-1]"), struct(
  translation=[620.2108 -819.4474 -27010],
  angle=3.141593,
  axis=[-5.551115e-17 0.7071068 0.7071068],
  ID="F[Part4-1:-:LongRail-1]"), struct(
  translation=[1.776357e-12 90 -27010],
  angle=2.094395,
  axis=[-0.5773503 -0.5773503 0.5773503],
  ID="B[Part4-1:-:LongRail-2]"), struct(
  translation=[618.269 500.4474 3000],
  angle=2.094395,
  axis=[0.5773503 -0.5773503 0.5773503],
  ID="F[Part4-1:-:LongRail-2]"), struct(translation=[84.86904 48.2 2992.86], angle=1.665335e-16, axis=[1 0 0], ID="B[Part4-1:-:Part4-5]"), struct(
  translation=[2484.869 41.8 2992.86],
  angle=3.141593,
  axis=[-1.50149e-16 -2.220446e-16 -1],
  ID="F[Part4-1:-:Part4-5]"), struct(
  translation=[2611.308 -744.811 458.9708],
  angle=2.094395,
  axis=[0.5773503 0.5773503 0.5773503],
  ID="B[CabinFrameAssmebly-1:-:Part4-5]"), struct(
  translation=[267.369 -645.6047 -398.9158],
  angle=1.570796,
  axis=[-2.299347e-17 -1 8.895227e-17],
  ID="F[CabinFrameAssmebly-1:-:Part4-5]"), struct(translation=[409 0 3000], angle=0, axis=[0 0 0], ID="B[Part4-5:-:Floor-1]"), struct(
  translation=[901.1056 3600 801.4704],
  angle=1.570796,
  axis=[-1 -1.779045e-16 6.688223e-17],
  ID="F[Part4-5:-:Floor-1]"), struct(
  translation=[0 0 -254],
  angle=2.094395,
  axis=[-0.5773503 -0.5773503 0.5773503],
  ID="B[Floor-1:-:Floor-2]"), struct(
  translation=[-2.16005e-12 3600 -254],
  angle=2.094395,
  axis=[-0.5773503 -0.5773503 0.5773503],
  ID="F[Floor-1:-:Floor-2]"), struct(
  translation=[0 0 -254],
  angle=2.094395,
  axis=[0.5773503 -0.5773503 0.5773503],
  ID="B[Floor-2:-:Floor-3]"), struct(
  translation=[-2.273737e-12 3600 -254],
  angle=2.094395,
  axis=[0.5773503 -0.5773503 0.5773503],
  ID="F[Floor-2:-:Floor-3]"), struct(
  translation=[0 0 -254],
  angle=2.094395,
  axis=[0.5773503 -0.5773503 0.5773503],
  ID="B[Floor-3:-:Floor-4]"), struct(
  translation=[-2.16005e-12 3600 -254],
  angle=2.094395,
  axis=[0.5773503 -0.5773503 0.5773503],
  ID="F[Floor-3:-:Floor-4]"), struct(translation=[0 0 2840], angle=0, axis=[0 0 0], ID="B[Floor-4:-:Floor-5]"), struct(translation=[-2.273737e-12 3600 2840], angle=0, axis=[0 0 0], ID="F[Floor-4:-:Floor-5]"), struct(
  translation=[0 0 -254],
  angle=2.094395,
  axis=[0.5773503 -0.5773503 0.5773503],
  ID="B[Floor-5:-:Floor-6]"), struct(
  translation=[-2.16005e-12 3600 -254],
  angle=2.094395,
  axis=[0.5773503 -0.5773503 0.5773503],
  ID="F[Floor-5:-:Floor-6]"), struct(
  translation=[0 0 -254],
  angle=2.094395,
  axis=[0.5773503 -0.5773503 0.5773503],
  ID="B[Floor-6:-:Floor-7]"), struct(
  translation=[-2.273737e-12 3600 -254],
  angle=2.094395,
  axis=[0.5773503 -0.5773503 0.5773503],
  ID="F[Floor-6:-:Floor-7]"), struct(
  translation=[0 0 -254],
  angle=2.094395,
  axis=[0.5773503 -0.5773503 0.5773503],
  ID="B[Floor-7:-:Floor-8]"), struct(
  translation=[-2.16005e-12 3600 -254],
  angle=2.094395,
  axis=[0.5773503 -0.5773503 0.5773503],
  ID="F[Floor-7:-:Floor-8]")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]

Shaft = struct(
  mass=4.31969,
  CoM=[0 0 275],
  MoI=[111592 111592 5399.612],
  PoI=[0 0 0],
  color=[0 0 0],
  opacity=1,
  ID="shaft*:*Default")

Sig = Simulink.Signal()
Solid = [struct(mass=[], CoM=[], MoI=[], PoI=[], color=[], opacity=[], ID=[]), struct(mass=[], CoM=[], MoI=[], PoI=[], color=[], opacity=[], ID=[]), struct(mass=[], CoM=[], MoI=[], PoI=[], color=[], opacity=[], ID=[]), struct(mass=[], CoM=[], MoI=[], PoI=[], color=[], opacity=[], ID=[]), struct(mass=[], CoM=[], MoI=[], PoI=[], color=[], opacity=[], ID=[]), struct(mass=[], CoM=[], MoI=[], PoI=[], color=[], opacity=[], ID=[]), struct(mass=[], CoM=[], MoI=[], PoI=[], color=[], opacity=[], ID=[]), struct(mass=[], CoM=[], MoI=[], PoI=[], color=[], opacity=[], ID=[]), struct(mass=[], CoM=[], MoI=[], PoI=[], color=[], opacity=[], ID=[]), struct(mass=[], CoM=[], MoI=[], PoI=[], color=[], opacity=[], ID=[]), struct(mass=[], CoM=[], MoI=[], PoI=[], color=[], opacity=[], ID=[]), struct(mass=[], CoM=[], MoI=[], PoI=[], color=[], opacity=[], ID=[]), struct(mass=[], CoM=[], MoI=[], PoI=[], color=[], opacity=[], ID=[]), struct(mass=[], CoM=[], MoI=[], PoI=[], color=[], opacity=[], ID=[]), struct(mass=0, CoM=[0 0 0], MoI=[0 0 0], PoI=[0 0 0], color=[0 0 0], opacity=0, ID="")]
g = 9.80665
scale = 0.2857143
x = 0.0944451787412
x2 = 0.1763245
DC_V = Simulink.Parameter(600, Unit="V")
SimulationElectrical_Timestep = Simulink.Parameter(0.001, Unit="s")