% Simulink data dictionary Data_TIDefinition.sldd

ADC_VMax = Simulink.Parameter(3.3, Unit="V")  % TI Controller maximum voltage for ADC aquisition.
ADC_VMin = Simulink.Parameter(0, Unit="V")  % TI Controller maximum voltage for ADC aquisition.
ADC_CountMax = Simulink.Parameter(4095)