test file "PerformanceTests"

suite "Model Performance at Realtime"

  case "PowerInverter with Simple Load (LC)" [real-time]
    description: Verify performance behavior of the model at runtime for realtime execution.
      It test if the Total Execition Time is under 10% at any given time (maximum TET).
      It test if no Overload happens over execution time.
    model SimulationMain, harness PowerInverter_SimpleLoad (for SimulationMain/ElevatorPlant/Plant_ElectromechanicalSubsystem/PowerInverter), stop time 20, target computer TargetPC1
    input "DataSignal_PowerInverter_SimpleLoad.mat", mapped to Gates_DutyCycle (active)
    assessment "Assessment1": At any point of time, double(TET) must be less than 2e-4
    assessment "Assessment2": At any point of time, double(OverloadCount) must be less than 1
      TET: signal PowerInverter_SimpleLoad/Overload Options, port 2
      OverloadCount: signal PowerInverter_SimpleLoad/Overload Options, port 1

  case "PowerInverter with Motor Load (PMSM)" [real-time]
    description: Verify performance behavior of the model at runtime for realtime execution.
      It test if the Total Execition Time is under 15% at any given time (maximum TET).
      It test if no Overload happens over execution time.
    model SimulationMain, harness PowerInverter_MotorLoad (for SimulationMain/ElevatorPlant/Plant_ElectromechanicalSubsystem/PowerInverter), stop time 20, target computer TargetPC1
    input "DataSignal_PowerInverter_SimpleLoad.mat", mapped to Gates_DutyCycle (active)
    assessment "Assessment1": At any point of time, double(TET) must be less than 3e-4
    assessment "Assessment2": At any point of time, double(OverloadCount) must be less than 1
      TET: signal PowerInverter_MotorLoad/Overload Options, port 2
      OverloadCount: signal PowerInverter_MotorLoad/Overload Options, port 1

  case "Plant_ElectromechanicalSubsystem with Simple Load" [real-time]
    description: Verify performance behavior of the model at runtime for realtime execution.
      It test if the Total Execition Time is under 20% at any given time (maximum TET).
      It test if no Overload happens over execution time.
    model SimulationMain, harness Plant_ElectromechanicalSubsystem_SimpleLoad (for SimulationMain/ElevatorPlant/Plant_ElectromechanicalSubsystem), stop time 20, target computer TargetPC1
    input "DataSignal_Plant_ElectromechanicalSubsystem_SimpleLoad.mat", mapped to Gates_DutyCycle (active)
    assessment "Assessment1": At any point of time, double(TET) must be less than 4e-4
    assessment "Assessment2": At any point of time, double(OverloadCount) must be less than 1
      TET: signal Plant_ElectromechanicalSubsystem_SimpleLoad/Overload Options, port 2
      OverloadCount: signal Plant_ElectromechanicalSubsystem_SimpleLoad/Overload Options, port 1

  case "Plant_ElectromechanicalSubsystem with Coupled Simple Load" [real-time] (disabled)
    description: DESABILITADO UMA VEZ QUE NENHUM GANHO DE PERFORMANCE OU PRECISÃO FORAM OBTIDOS
      Verify performance behavior of the model at runtime for realtime execution.
      It test if the Total Execition Time is under 20% at any given time (maximum TET).
      It test if no Overload happens over execution time.
    model SimulationMain, harness Plant_ElectromechanicalSubsystem_CoupledSimpleLoad (for SimulationMain/ElevatorPlant/Plant_ElectromechanicalSubsystem), stop time 20, target computer TargetPC1
    input "DataSignal_Plant_ElectromechanicalSubsystem_SimpleLoad.mat", mapped to Gates_DutyCycle (active)
    assessment "Assessment1": At any point of time, double(TET) must be less than 4e-4
    assessment "Assessment2": At any point of time, double(OverloadCount) must be less than 1
      TET: signal Plant_ElectromechanicalSubsystem_CoupledSimpleLoad/Overload Options, port 2
      OverloadCount: signal Plant_ElectromechanicalSubsystem_CoupledSimpleLoad/Overload Options, port 1

  case "ElevatorAssembly with Simple Torque" [real-time]
    description: Verify performance behavior of the model at runtime for realtime execution.
      It test if the Total Execition Time is under 60% at any given time (maximum TET).
      It test if no Overload happens over execution time.
    model SimulationMain, harness ElevatorAssembly_SimpleTorque (for SimulationMain/ElevatorPlant/ElevatorAssembly), target computer TargetPC1
    input "DataSignal_ElevatorAssembly_SimpleTorque.mat", mapped to Door_t, Torque (active)
    assessment "Assessment1": At any point of time, double(TET) must be less than 12e-4
    assessment "Assessment2": At any point of time, double(OverloadCount) must be less than 1
      TET: signal ElevatorAssembly_SimpleTorque/Overload Options, port 2
      OverloadCount: signal ElevatorAssembly_SimpleTorque/Overload Options, port 1

  case "ElevatorPlant with Variable Switching" [real-time]
    description: Verify performance behavior of the model at runtime for realtime execution.
      It test if the Total Execition Time is under 60% at any given time (maximum TET).
      It test if no Overload happens over execution time.
    model SimulationMain, harness ElevatorPlant_VariableSwitching (for SimulationMain/ElevatorPlant), stop time 20, target computer TargetPC1
    input "DataSignal_ElevatorPlant_VariableSwitching.mat", mapped to PowerInverter_Gates_DutyCycle, Door_t (active)
    assessment "Assessment1": At any point of time, double(TET) must be less than 12e-4
    assessment "Assessment2": At any point of time, double(OverloadCount) must be less than 1
      TET: signal ElevatorPlant_VariableSwitching/Overload Options, port 2
      OverloadCount: signal ElevatorPlant_VariableSwitching/Overload Options, port 1

  case "SpeedgoatInterface at Standalone Run" [real-time]
    model SimulationMain, harness SpeedgoatInterface_StandaloneRun (for SimulationMain/SpeedgoatInterface), stop time 10, target computer TargetPC1
    input "DataSignal_SpeedgoatInterface_StandaloneRun.mat", mapped to CurrentSensor_Uab, Shaft_omega (active)
    assessment "Assessment1": At any point of time, double(TET) must be less than 2e-4
    assessment "Assessment2": At any point of time, double(OverloadCount) must be less than 1
      TET: signal SpeedgoatInterface_StandaloneRun/Overload Options, port 2
      OverloadCount: signal SpeedgoatInterface_StandaloneRun/Overload Options, port 1